# Grasshopper definition comfyui_3d.gh (Grasshopper 1.0.7)
# plug-ins: Python, ComfyUIsett

path = FilePath("E:\ComfyUI_windows_portable\ComfyUI\models\")
path_2 = FilePath("C:\Users\archi\source\repos\Grasshopper_ComfyUI\Examples\ComfyUi3D\create_3d.json")
path_3 = FilePath("H:\comfyui_3d\")
model = LoadModel(modelfolder=path, pathid=Slider(1, range=0..30), fileid=Slider(5, range=0..30))  # -> out, Models_list, Model; inputs pathid: Int32, fileid: Int32
# ---------- model: Python ----------
ghenv.Component.Name = 'Load Model'
ghenv.Component.NickName = 'Model'
ghenv.Component.Description = 'Load Model from ComfyUI folder'
ghenv.Component.Category = 'Params'
ghenv.Component.SubCategory = 'ComfyUI'
ghenv.Component.Params.Input[0].Description = "ComfyUI Models folder"
ghenv.Component.Params.Input[1].Description = "Model path index"
ghenv.Component.Params.Input[2].Description = "Model file index"

import os

def list_files_and_subfolders(folder):
    allfiles = []
    for root, dirs, files in os.walk(folder):
        for name in files:
            file_path = os.path.join(root, name)
            file_ = file_path.replace(folder + os.sep, "")
            allfiles.append(file_)
            #print("File:", file_path.replace(folder + os.sep, ""))
    return allfiles
    
if modelfolder and pathid is not None and fileid is not None:
    subfolders = next(os.walk(modelfolder))[1]
    pathid %= len(subfolders)

    sub_folder = subfolders[pathid]
    subfolder_path = [os.path.join(modelfolder, subfolder) for subfolder in subfolders][pathid]

    Modelslist = list_files_and_subfolders(subfolder_path)
    if Modelslist:
        fileid %= len(Modelslist)
        Model = '"'+ Modelslist[fileid]+'"'
    
    ghenv.Component.Message = sub_folder
# ---------- end model ----------
path_4 = FilePath("E:\ComfyUI_windows_portable\run_cpu_gh.bat")
panel = Panel(model.Model)
json2py = JsonToPython(jsonfile=path_2, folder=path_3, save=Button())  # -> pyfile, ComfyUI_Inputs; inputs save: Boolean
# ---------- json2py: Python ----------
ghenv.Component.Name = 'Json to Python'
ghenv.Component.NickName = 'Json2Py'
ghenv.Component.Description = 'Convert ComfyUI Json to Python'
ghenv.Component.Category = 'Params'
ghenv.Component.SubCategory = 'ComfyUI'
ghenv.Component.Params.Input[0].Description = "API Json file"
ghenv.Component.Params.Input[1].Description = "Folder to save Python file"
ghenv.Component.Params.Input[2].Description = "Button to save Python file"

from ghpythonlib.componentbase import executingcomponent as component
import Grasshopper, GhPython
import System
import Rhino
import rhinoscriptsyntax as rs
import json
import os
        
class MyComponent(component):
    
    def RunScript(self, jsonfile, folder, save):
        if not jsonfile or not folder: return
        def get_inputs_for_class_type(prompt, class_type):
            inputs = []
            gh_values = []
            for key, value in prompt.items():
                if value.get("_meta", {}).get("title", "").startswith("GH"):
                    if value.get("class_type") == class_type:
                        if "inputs" in value:
                            for sub_key, sub_value in value["inputs"].items():
                                if sub_key.startswith("input_val"):
                                    title = value.get("_meta", {}).get("title", "")
                                    if title == "GHSampler":
                                        type_value = sub_key.replace("input_val_", "")
                                        gh_value = SamplerTypeVal(type_value) + "_" + type_value
                                        inputs.append(('prompt["{}"]["inputs"]["{}"] = {}'.format(key, sub_key, gh_value), gh_value))
                                    else:
                                        gh_value = value.get("_meta", {}).get("title", "") + "_" + value["inputs"]["nickname"]
                                        inputs.append(('prompt["{}"]["inputs"]["{}"] = {}'.format(key, sub_key, gh_value), gh_value))
                                    gh_values.append(gh_value)
            return inputs, gh_values
            
        def sort_class_types(class_type):
            try:
                return int(class_type.split()[0])
            except ValueError:
                return float('inf')
                
        def SamplerTypeVal(value):
            if value == "seed" or value == "steps":
                title = "GHInteger"
            elif value == "cfg" or value == "denoise":
                title = "GHFloat"
            elif value == "scheduler" or value == "sampler":
                title = "GHString"
            return title
            
        def generate_parse_arguments(argument_list):
            #argument_list.append("APIjsonfile")
            function_string = "def parse_arguments(args):\n"
            for arg in argument_list:
                function_string += "    {} = \"\"\n".format(arg)
            function_string += "    for i in range(len(args)):\n"
            for idx, arg in enumerate(argument_list):
                if idx == 0:
                    function_string += "        if args[i] == \"--{}\" and i + 1 < len(args):\n".format(arg)
                else:
                    function_string += "        elif args[i] == \"--{}\" and i + 1 < len(args):\n".format(arg)
                function_string += "            {} = args[i + 1]\n".format(arg)
            items = ", ".join(argument_list)  # Combine all items of argument_list
            function_string += "    return " + items + "\n"
            last_line = items + " = " + "parse_arguments(sys.argv[1:])\n"
            final_string = function_string + last_line
            return final_string
        
        
        def CreatePythonFile(jsonFile, saveFolder):
            if not jsonFile or not saveFolder: 
                return None, None, None, None, None
            
            file_name = os.path.splitext(os.path.basename(jsonFile))[0]
            pyfile = saveFolder + file_name + '.py'
            
            # Load the prompt text from the JSON file
            with open(jsonFile, "r") as file:
                prompt = json.load(file)
                
            # Iterate over the dictionary to retrieve the assignments
            class_types = sorted(set(value.get("class_type") for value in prompt.values()), key=sort_class_types)
            assignments = []
            gh_values = []
            id_values = []
            for class_type in class_types:
                inputs, class_gh_values = get_inputs_for_class_type(prompt, class_type)
                if inputs:
                    gh_values.extend(class_gh_values)
                    # Include the category header before the loop starts
                    assignments.append('#class type: {}'.format(class_type))
                    for input_line, value in inputs:
                        if isinstance(value, list):
                            assignments.append('{}{}'.format(input_line, value))
                        else:
                            assignments.append('{}'.format(input_line, value))

            gh_values.append("APIjsonfile")
            
            # Convert assignments to a single string
            assignment_text = '\n'.join(assignments)
            function_string = generate_parse_arguments(gh_values)
            
            return assignment_text, function_string, pyfile, gh_values
        
        assignment_text, function_string, pyfile, gh_values = CreatePythonFile(jsonfile, folder)
        
        # Base code
        base_code = """# Created by Seghier Mohamed Abdelaziz - seghierdesign@gmail.com
        
""" + "# " + jsonfile + """
import json
import sys
from urllib import request
        
""" + function_string + """
def queue_prompt(prompt):
    p = {"prompt": prompt}
    data = json.dumps(p).encode('utf-8')
    req =  request.Request("http://127.0.0.1:8188/prompt", data=data)
    request.urlopen(req)
    
with open(APIjsonfile, 'r', encoding='utf-8') as file:
    prompt = json.load(file)

# GH inputs
""" + assignment_text + """

queue_prompt(prompt)
"""
        
        if save:
            # Save the combined code as a Python script
            with open(pyfile, "w") as output_file:
                output_file.write(base_code)
                
        return (pyfile, gh_values)
# ---------- end json2py ----------
json2py_2 = JsonToPython(jsonfile=path_2, folder=path_3, save=Button())  # -> pyfile, ComfyUI_Inputs; inputs save: Boolean
# ---------- json2py_2: Python ----------
ghenv.Component.Name = 'Json to Python'
ghenv.Component.NickName = 'Json2Py'
ghenv.Component.Description = 'Convert ComfyUI Json to Python'
ghenv.Component.Category = 'Params'
ghenv.Component.SubCategory = 'ComfyUI'
ghenv.Component.Params.Input[0].Description = "API Json file"
ghenv.Component.Params.Input[1].Description = "Folder to save Python file"
ghenv.Component.Params.Input[2].Description = "Button to save Python file"

from ghpythonlib.componentbase import executingcomponent as component
import Grasshopper, GhPython
import System
import Rhino
import rhinoscriptsyntax as rs
import json
import os
        
class MyComponent(component):
    
    def RunScript(self, jsonfile, folder, save):
        if not jsonfile or not folder: return
        def get_inputs_for_class_type(prompt, class_type):
            input_ids = []
            inputs = []
            gh_values = []
            for key, value in prompt.items():
                
                if value.get("_meta", {}).get("title", "").startswith("GH"):
                    if value.get("class_type") == class_type:
                        if "inputs" in value:
                            #nickname =  value["inputs"]["nickname"]
                            inputid =  value["inputs"]["input_id"]
                            #inputvalue = value["inputs"]["input_val"]
                            input_ids.append(inputid)
                            for sub_key, sub_value in value["inputs"].items():
                                if sub_key != "nickname" and not sub_key.endswith("_id"):
                                    gh_value = value.get("_meta", {}).get("title", "") + "_" + value["inputs"]["nickname"]
                                    gh_values.append(gh_value)
                                    inputs.append(('prompt["{}"]["inputs"]["{}"] = {}'.format(key, sub_key, gh_value), gh_value))
                                    break  # Break the loop after retrieving the first valid input
            return inputs, gh_values, input_ids
            
        def sort_class_types(class_type):
            try:
                return int(class_type.split()[0])
            except ValueError:
                return float('inf')
                
        def generate_parse_arguments(argument_list):
            #argument_list.append("APIjsonfile")
            function_string = "def parse_arguments(args):\n"
            for arg in argument_list:
                function_string += "    {} = \"\"\n".format(arg)
            function_string += "    for i in range(len(args)):\n"
            for idx, arg in enumerate(argument_list):
                if idx == 0:
                    function_string += "        if args[i] == \"--{}\" and i + 1 < len(args):\n".format(arg)
                else:
                    function_string += "        elif args[i] == \"--{}\" and i + 1 < len(args):\n".format(arg)
                function_string += "            {} = args[i + 1]\n".format(arg)
            items = ", ".join(argument_list)  # Combine all items of argument_list
            function_string += "    return " + items + "\n"
            last_line = items + " = " + "parse_arguments(sys.argv[1:])\n"
            final_string = function_string + last_line
            return final_string
        
        
        def CreatePythonFile(jsonFile, saveFolder):
            if not jsonFile or not saveFolder: 
                return None, None, None, None, None
            
            file_name = os.path.splitext(os.path.basename(jsonFile))[0]
            pyfile = saveFolder + file_name + '.py'
            
            # Load the prompt text from the JSON file
            with open(jsonFile, "r") as file:
                prompt = json.load(file)
                
            # Iterate over the dictionary to retrieve the assignments
            class_types = sorted(set(value.get("class_type") for value in prompt.values()), key=sort_class_types)
            assignments = []
            gh_values = []
            id_values = []
            for class_type in class_types:
                inputs, class_gh_values, input_ids = get_inputs_for_class_type(prompt, class_type)
                if inputs:
                    gh_values.extend(class_gh_values)
                    id_values.extend(input_ids)
                    # Include the category header before the loop starts
                    assignments.append('#class type: {}'.format(class_type))
                    for input_line, value in inputs:
                        if isinstance(value, list):
                            assignments.append('{}{}'.format(input_line, value))
                        else:
                            assignments.append('{}'.format(input_line, value))
                            
            #sort lists
            sorted_id_values = sorted(id_values)
            paired_values = list(zip(id_values, gh_values))
            sorted_pairs = sorted(paired_values, key=lambda pair: pair[0])
            sorted_gh_values = [pair[1] for pair in sorted_pairs]
            sorted_id_values.append(len(gh_values)-1)
            sorted_gh_values.append("APIjsonfile")
            
            # Convert assignments to a single string
            assignment_text = '\n'.join(assignments)
            function_string = generate_parse_arguments(sorted_gh_values)
            
            return assignment_text, function_string, pyfile, sorted_gh_values, sorted_id_values
        
        assignment_text, function_string, pyfile, gh_values, id_values = CreatePythonFile(jsonfile, folder)
        
        # Base code
        base_code = """# Created by Seghier Mohamed Abdelaziz - seghierdesign@gmail.com
        
""" + "# " + jsonfile + """
import json
import sys
from urllib import request
        
""" + function_string + """
def queue_prompt(prompt):
    p = {"prompt": prompt}
    data = json.dumps(p).encode('utf-8')
    req =  request.Request("http://127.0.0.1:8188/prompt", data=data)
    request.urlopen(req)
    
with open(APIjsonfile, 'r', encoding='utf-8') as file:
    prompt = json.load(file)

# GH inputs
""" + assignment_text + """

queue_prompt(prompt)
"""
        
        if save:
            # Save the combined code as a Python script
            with open(pyfile, "w") as output_file:
                output_file.write(base_code)
                
        return (pyfile, gh_values)
# ---------- end json2py_2 ----------
runcomfyui = RunComfyUI(Run=Button(), ComfyUI=path_4)  # -> out; inputs Run: Boolean, ComfyUI: String
# ---------- runcomfyui: C# usings ----------
using System.Diagnostics;
# ---------- runcomfyui: C# ----------
    //------------------------------------------
    Component.Name = "Run ComfyUI";
    Component.NickName = "RunComfyUI";
    Component.Category = "Params";
    Component.SubCategory = "ComfyUI";
    Component.Description = "Run ComfyUI";
    Component.Params.Input[0].NickName = "Run";
    Component.Params.Input[0].Description = "Button to run ComfyUI";
    Component.Params.Input[1].NickName = "ComfyUI";
    Component.Params.Input[1].Description = "Path of: run_cpu_gh.bat";
    //------------------------------------------
    if(ComfyUI == null) return;
    if (Run)
    {
      Process.Start(ComfyUI);
    }
# ---------- end runcomfyui ----------
path_5 = FilePath("H:\comfyui_3d\car.png")
file = ReadFile(File=json2py_2.pyfile, PerLineParse=True)
comfyuisets = ComfyUISettings(
    Inputs=json2py_2.ComfyUI_Inputs,
    GHBool_invertmask=Toggle(True),
    GHFile_imagefile=path_5,
    GHFile_model=panel,
    GHInteger_resolution=Slider(2, range=1..4, expression="x*128"),
    APIjsonfile=path_2,
    DeleteInputs=True,
    Names="GHFile_model,GHInteger_resolution,GHBool_invertmask,GHFile_imagefile,APIjsonfile")  # -> Parameters, Arguments
panel_2 = Panel(json2py_2.ComfyUI_Inputs)
file_2 = ReadFile(File=json2py.pyfile, PerLineParse=True)
path_6 = FilePath("E:\ComfyUI_windows_portable\ComfyUI\output\")
meshfile = MeshFile(Folder=path_6)  # -> out, MeshFile; inputs Folder: String
# ---------- meshfile: C# usings ----------
using System.IO;
using System.Linq;
# ---------- meshfile: C# ----------
    //------------------------------------------
    Component.Name = "Mesh File";
    Component.NickName = "MeshFile";
    Component.Category = "Params";
    Component.SubCategory = "ComfyUI";
    Component.Description = "Mesh result file";
    Component.Params.Input[0].NickName = "Folder";
    Component.Params.Input[0].Description = "ComfyUI output folder";
    //------------------------------------------
    if (Folder == null) return;
    MeshFile = GetImagePath(Folder);
# ---------- meshfile: C# additional code ----------
  string GetImagePath(string folderPath)
  {
    // Get all PNG files in the folder
    string[] meshFiles = Directory.GetFiles(folderPath, "*.obj");

    // Filter out non-existent files and order by creation time in descending order
    var latestFile = meshFiles
      .Where(file => File.Exists(file))
      .OrderByDescending(file => new FileInfo(file).CreationTime)
      .FirstOrDefault();

    if (latestFile != null)
    {
      return latestFile;
    }
    else
    {
      Console.WriteLine("No OBJ files found in the folder: " + folderPath);
      return null; // Return null to indicate no image found
    }
  }
# ---------- end meshfile ----------
panel_3 = Panel(file_2)
comfyui_parameters = Panel(comfyuisets.Parameters)
path_7 = FilePath("E:\ComfyUI_windows_portable\python_embeded\python.exe")
path_8 = FilePath(json2py_2.pyfile)
meshresult = LoadMeshResult(Mesh=meshfile.MeshFile)  # -> geos, attrs
# ---------- meshresult: Python ----------
ghenv.Component.Name = 'Load Mesh Result'
ghenv.Component.NickName = 'MeshResult'
ghenv.Component.Description = 'Load Mesh Result from ComfyUI output folder'
ghenv.Component.Category = 'Params'
ghenv.Component.SubCategory = 'ComfyUI'
ghenv.Component.Params.Input[0].Description = "Resulting Mesh path"

from ghpythonlib.componentbase import executingcomponent as component
import Grasshopper, GhPython
import System
import Rhino
import rhinoscriptsyntax as rs

class MyComponent(component):
    
    def RunScript(self, Mesh):
        if not Mesh: return
        readopt = Rhino.FileIO.FileObjReadOptions(Rhino.FileIO.FileReadOptions())
        
        headless = Rhino.RhinoDoc.CreateHeadless(None)
        headless.Import(Mesh)
        geos = []
        attrs = []
        for obj in headless.Objects:
            geos.append(obj.Geometry.Duplicate())
            attrs.append(obj.Attributes)
        
        # return outputs if you have them; here I try it for you:
        return (geos, attrs)
# ---------- end meshresult ----------
scale = Scale(Geometry=meshresult.geos, Center=Point(0, 0, 0), Factor=Slider(20, range=0..20))  # -> Geometry, Transform
Y = UnitY(Factor=expr("-x", Slider(19.18, range=0..20)))
dam = DataDam(DataA=scale.Geometry, BufferDelay=10000000, BufferMode=0)  # disabled
queueprompt = QueuePrompt(Run=Button(), Python_exe=path_7, Python_script=path_8, Arguments=comfyuisets.Arguments)  # -> out, Command; inputs Run: Boolean, Python_exe: String, Python_script: String, Arguments: String
# ---------- queueprompt: C# usings ----------
using System.Diagnostics;
using System.IO;
using System.Linq;
# ---------- queueprompt: C# ----------
    //------------------------------------------
    Component.Name = "Queue Prompt";
    Component.NickName = "QueuePrompt";
    Component.Category = "Params";
    Component.SubCategory = "ComfyUI";
    Component.Description = "Queue Prompt";
    Component.Params.Input[0].NickName = "Run";
    Component.Params.Input[1].NickName = "Python_exe";
    Component.Params.Input[2].NickName = "Python_script";
    Component.Params.Input[3].NickName = "Arguments";
    Component.Params.Input[0].Description = "Button to run the Queue";
    Component.Params.Input[1].Description = "Path of ComfyUI python.exe";
    Component.Params.Input[2].Description = "Path of the converted python script from Json file";
    Component.Params.Input[3].Description = "Command arguments";
    //------------------------------------------

    if(Python_exe == null || Python_script == null || Arguments == null) return;

    Process process = null;

    // Set up process start info
    ProcessStartInfo startInfo = new ProcessStartInfo();
    startInfo.FileName = Python_exe;
    startInfo.Arguments = Python_script + " " + Arguments;
    startInfo.CreateNoWindow = false; // This prevents the command prompt window from appearing
    startInfo.UseShellExecute = false;
    startInfo.RedirectStandardOutput = true;

    Command = startInfo.Arguments;
    // Start the process
    if (Run)
    {
      process = Process.Start(startInfo);
    }
# ---------- end queueprompt ----------
swatch = ColourSwatch(SwatchColor=RGB(189, 189, 189))
qrmesh = QuadRemesh(Mesh=dam, Settings={aqc=True, as=50, dhe=True, gci=0, null=False, pme=0, sa=0, tqc=2000})
move = Move(Geometry=qrmesh, Motion=Y)  # -> Geometry, Transform
meshsubd = MeshToSubd(Mesh=move.Geometry)
transform = Transform(Geometry=meshsubd, Transform=move.Transform)
subdedges = SubDEdges(SubD=transform, NewFormatting=False)  # -> Line, Edge, Tag, Id
preview = CustomPreview(Geometry=move.Geometry, Material=swatch)
medges = MeshEdges(Mesh=move.Geometry)  # -> NakedEdges, InteriorEdges, NonManifoldEdges
preview_2 = CustomPreview(Geometry=transform, Material=swatch)
preview_3 = CustomPreview(Geometry=subdedges.Edge, Material=ColourSwatch(SwatchColor=RGB(0, 0, 0)))
panel_4 = Panel(queueprompt.Command)
