# Grasshopper definition simple example.gh (Grasshopper 1.0.7)
# plug-ins: ComfyUIsett

# Path of: API Json file
# Folder where you
#  save your work
button = Button()
# Path of: run_cpu_gh.bat
# or: run_gpu_gh.bat
path = FilePath("H:\rh_comfyui\Comfy_GH_example.json")
path_2 = FilePath("H:\rh_comfyui\")
# ComfyUI "models" folder
number_slider = Slider(1, range=0..40)
samplerseed = SamplerSeed(FixedSeed=-1, NewSeed=Button())
json2py = JsonToPython(jsonfile=path, folder=path_2, save=button)  # -> pyfile, ComfyUI_Inputs; inputs save: Boolean
# ---------- json2py: Python ----------
ghenv.Component.Name = 'Json to Python'
ghenv.Component.NickName = 'Json2Py'
ghenv.Component.Description = 'Convert ComfyUI Json to Python'
ghenv.Component.Category = 'Params'
ghenv.Component.SubCategory = 'ComfyUI'
ghenv.Component.Params.Input[0].Description = "API Json file"
ghenv.Component.Params.Input[1].Description = "Folder to save Python file"
ghenv.Component.Params.Input[2].Description = "Button to save Python file"

from ghpythonlib.componentbase import executingcomponent as component
import Grasshopper, GhPython
import System
import Rhino
import rhinoscriptsyntax as rs
import json
import os
        
class MyComponent(component):
    
    def RunScript(self, jsonfile, folder, save):
        if not jsonfile or not folder: return
        def get_inputs_for_class_type(prompt, class_type):
            input_ids = []
            inputs = []
            gh_values = []
            for key, value in prompt.items():
                
                if value.get("_meta", {}).get("title", "").startswith("GH"):
                    if value.get("class_type") == class_type:
                        if "inputs" in value:
                            #nickname =  value["inputs"]["nickname"]
                            inputid =  value["inputs"]["input_id"]
                            #inputvalue = value["inputs"]["input_val"]
                            input_ids.append(inputid)
                            for sub_key, sub_value in value["inputs"].items():
                                if sub_key != "nickname" and not sub_key.endswith("_id"):
                                    gh_value = value.get("_meta", {}).get("title", "") + "_" + value["inputs"]["nickname"]
                                    gh_values.append(gh_value)
                                    inputs.append(('prompt["{}"]["inputs"]["{}"] = {}'.format(key, sub_key, gh_value), gh_value))
                                    break  # Break the loop after retrieving the first valid input
            return inputs, gh_values, input_ids
            
        def sort_class_types(class_type):
            try:
                return int(class_type.split()[0])
            except ValueError:
                return float('inf')
                
        def generate_parse_arguments(argument_list):
            #argument_list.append("APIjsonfile")
            function_string = "def parse_arguments(args):\n"
            for arg in argument_list:
                function_string += "    {} = \"\"\n".format(arg)
            function_string += "    for i in range(len(args)):\n"
            for idx, arg in enumerate(argument_list):
                if idx == 0:
                    function_string += "        if args[i] == \"--{}\" and i + 1 < len(args):\n".format(arg)
                else:
                    function_string += "        elif args[i] == \"--{}\" and i + 1 < len(args):\n".format(arg)
                function_string += "            {} = args[i + 1]\n".format(arg)
            items = ", ".join(argument_list)  # Combine all items of argument_list
            function_string += "    return " + items + "\n"
            last_line = items + " = " + "parse_arguments(sys.argv[1:])\n"
            final_string = function_string + last_line
            return final_string
        
        
        def CreatePythonFile(jsonFile, saveFolder):
            if not jsonFile or not saveFolder: 
                return None, None, None, None, None
            
            file_name = os.path.splitext(os.path.basename(jsonFile))[0]
            pyfile = saveFolder + file_name + '.py'
            
            # Load the prompt text from the JSON file
            with open(jsonFile, "r") as file:
                prompt = json.load(file)
                
            # Iterate over the dictionary to retrieve the assignments
            class_types = sorted(set(value.get("class_type") for value in prompt.values()), key=sort_class_types)
            assignments = []
            gh_values = []
            id_values = []
            for class_type in class_types:
                inputs, class_gh_values, input_ids = get_inputs_for_class_type(prompt, class_type)
                if inputs:
                    gh_values.extend(class_gh_values)
                    id_values.extend(input_ids)
                    # Include the category header before the loop starts
                    assignments.append('#class type: {}'.format(class_type))
                    for input_line, value in inputs:
                        if isinstance(value, list):
                            assignments.append('{}{}'.format(input_line, value))
                        else:
                            assignments.append('{}'.format(input_line, value))
                            
            #sort lists
            sorted_id_values = sorted(id_values)
            paired_values = list(zip(id_values, gh_values))
            sorted_pairs = sorted(paired_values, key=lambda pair: pair[0])
            sorted_gh_values = [pair[1] for pair in sorted_pairs]
            sorted_id_values.append(len(gh_values)-1)
            sorted_gh_values.append("APIjsonfile")
            
            # Convert assignments to a single string
            assignment_text = '\n'.join(assignments)
            function_string = generate_parse_arguments(sorted_gh_values)
            
            return assignment_text, function_string, pyfile, sorted_gh_values, sorted_id_values
        
        assignment_text, function_string, pyfile, gh_values, id_values = CreatePythonFile(jsonfile, folder)
        
        # Base code
        base_code = """# Created by Seghier Mohamed Abdelaziz - seghierdesign@gmail.com
        
""" + "# " + jsonfile + """
import json
import sys
from urllib import request
        
""" + function_string + """
def queue_prompt(prompt):
    p = {"prompt": prompt}
    data = json.dumps(p).encode('utf-8')
    req =  request.Request("http://127.0.0.1:8188/prompt", data=data)
    request.urlopen(req)
    
with open(APIjsonfile, 'r', encoding='utf-8') as file:
    prompt = json.load(file)

# GH inputs
""" + assignment_text + """

queue_prompt(prompt)
"""
        
        if save:
            # Save the combined code as a Python script
            with open(pyfile, "w") as output_file:
                output_file.write(base_code)
                
        return (pyfile, gh_values)
# ---------- end json2py ----------
panel = Panel(json2py.ComfyUI_Inputs)
path_3 = FilePath("E:\ComfyUI_windows_portable\ComfyUI\models\")
samplers = Samplers({"euler", "euler_ancestral", "heun", "heunpp2", "dpm_2", "dpm_2_ancestral", "lms", "dpm_fast", "dpm_adaptive", "dpmpp_2s_ancestral", "dpmpp_sde", "dpmpp_sde_gpu", "dpmpp_2m", "dpmpp_2m_sde", "dpmpp_2m_sde_gpu", "dpmpp_3m_sde", "dpmpp_3m_sde_gpu", "ddpm", "lcm", "ddim", "uni_pc", "uni_pc_bh2"}, selected="dpmpp_sde")
schedulers = Schedulers({"normal", "karras", "exponential", "sgm_uniform", "simple", "ddim_uniform"}, selected="karras")
path_4 = FilePath()
ghprompt_positive = Panel("grasshopper in the woods, realistic, 4k")
ghprompt_negative = Panel("text, watermark")
model = LoadModel(modelfolder=path_3, pathid=number_slider, fileid=Slider(0, range=0..20))  # -> out, Models_list, Model; inputs pathid: Int32, fileid: Int32
# ---------- model: Python ----------
ghenv.Component.Name = 'Load Model'
ghenv.Component.NickName = 'Model'
ghenv.Component.Description = 'Load Model from ComfyUI folder'
ghenv.Component.Category = 'Params'
ghenv.Component.SubCategory = 'ComfyUI'
ghenv.Component.Params.Input[0].Description = "ComfyUI Models folder"
ghenv.Component.Params.Input[1].Description = "Model path index"
ghenv.Component.Params.Input[2].Description = "Model file index"

import os

def list_files_and_subfolders(folder):
    allfiles = []
    for root, dirs, files in os.walk(folder):
        for name in files:
            file_path = os.path.join(root, name)
            file_ = file_path.replace(folder + os.sep, "")
            allfiles.append(file_)
            #print("File:", file_path.replace(folder + os.sep, ""))
    return allfiles
    
if modelfolder and pathid is not None and fileid is not None:
    subfolders = next(os.walk(modelfolder))[1]
    pathid %= len(subfolders)

    sub_folder = subfolders[pathid]
    subfolder_path = [os.path.join(modelfolder, subfolder) for subfolder in subfolders][pathid]

    Modelslist = list_files_and_subfolders(subfolder_path)
    if Modelslist:
        fileid %= len(Modelslist)
        Model = '"'+ Modelslist[fileid]+'"'
    
    ghenv.Component.Message = sub_folder
# ---------- end model ----------
runcomfyui = RunComfyUI(Run=Button(), ComfyUI=path_4)  # -> out; inputs Run: Boolean, ComfyUI: String
# ---------- runcomfyui: C# usings ----------
using System.Diagnostics;
# ---------- runcomfyui: C# ----------
    //------------------------------------------
    Component.Name = "Run ComfyUI";
    Component.NickName = "RunComfyUI";
    Component.Category = "Params";
    Component.SubCategory = "ComfyUI";
    Component.Description = "Run ComfyUI";
    Component.Params.Input[0].NickName = "Run";
    Component.Params.Input[0].Description = "Button to run ComfyUI";
    Component.Params.Input[1].NickName = "ComfyUI";
    Component.Params.Input[1].Description = "Path of: run_cpu_gh.bat";
    //------------------------------------------
    if(ComfyUI == null) return;
    if (Run)
    {
      Process.Start(ComfyUI);
    }
# ---------- end runcomfyui ----------
ghstring_sampler = Panel("dpmpp_sde")
ghstring_scheduler = Panel("karras")
ghinteger_height = Slider(256, range=100..10000)
ghinteger_width = Slider(256, range=100..10000)
ghinteger_batch = Slider(1, range=1..10)
ghfloat_denoise = Slider(1, range=0..1)
ghinteger_steps = Slider(10, range=0..100)
ghinteger_seed = Slider(-1, range=-1..1e+13)
ghstring_model = Panel(model.Model)
ghfloat_cfg = Slider(8, range=0..10)
# ComfyUI "output" folder
panel_2 = Panel(model.Model)
panel_3 = Panel(json2py.pyfile)
comfyuisets = ComfyUISettings(
    Inputs=panel,
    GHPrompt_positive=ghprompt_positive,
    GHPrompt_negative=ghprompt_negative,
    GHString_model=ghstring_model,
    GHInteger_width=ghinteger_width,
    GHInteger_height=ghinteger_height,
    GHInteger_batch=ghinteger_batch,
    GHInteger_seed=ghinteger_seed,
    GHInteger_steps=ghinteger_steps,
    GHFloat_cfg=ghfloat_cfg,
    GHFloat_denoise=ghfloat_denoise,
    GHString_sampler=ghstring_sampler,
    GHString_scheduler=ghstring_scheduler,
    APIjsonfile=path,
    DeleteInputs=True,
    Names="GHPrompt_positive,GHPrompt_negative,GHString_model,GHInteger_width,GHInteger_height,GHInteger_batch,GHInteger_seed,GHInteger_steps,GHFloat_cfg,GHFloat_denoise,GHString_sampler,GHString_scheduler,APIjsonfile")  # -> Parameters, Arguments
# ComfyUI "python.exe"
path_5 = FilePath("E:\ComfyUI_windows_portable\ComfyUI\output\")
imagefile = ImageFile(Folder=path_5)  # -> out, ImageFile; inputs Image_Name: String, Folder: String
# ---------- imagefile: C# usings ----------
using System.IO;
using System.Linq;
# ---------- imagefile: C# ----------
    //------------------------------------------
    Component.Name = "Image File";
    Component.NickName = "ImageFile";
    Component.Category = "Params";
    Component.SubCategory = "ComfyUI";
    Component.Description = "Image result file";
    Component.Params.Input[0].NickName = "Image_Name";
    Component.Params.Input[1].NickName = "Folder";
    Component.Params.Input[0].Description = "Image name in case it used in the Workflow";
    Component.Params.Input[1].Description = "ComfyUI output folder";
    //------------------------------------------
    if(Folder == null) return;
    if (Image_Name == null)
      Image_Name = "ComfyUI";
    ImageFile = GetImagePath(Folder, Image_Name);
# ---------- imagefile: C# additional code ----------
  string GetImagePath(string folderPath, string searchString)
  {
    // Get all PNG files in the folder
    string[] pngFiles = Directory.GetFiles(folderPath, "*" + searchString + "*.png");

    // Filter out non-existent files and order by creation time in descending order
    var latestFile = pngFiles
      .Where(file => File.Exists(file))
      .OrderByDescending(file => new FileInfo(file).CreationTime)
      .FirstOrDefault();

    if (latestFile != null)
    {
      return latestFile;
    }
    else
    {
      Console.WriteLine("No PNG files found in the folder: " + folderPath);
      return null; // Return null to indicate no image found
    }
  }
# ---------- end imagefile ----------
comfyuiaddsrc = ComfyUIAddSources(Add=Button(), KeepInputs=False)
path_6 = FilePath("H:\rh_comfyui\Comfy_GH_example.py")
path_7 = FilePath("E:\ComfyUI_windows_portable\python_embeded\python.exe")
panel_4 = Panel(comfyuisets.Arguments)
image_resource = ImageResource(imagefile.ImageFile)
comfyui_parameters = Panel(comfyuisets.Parameters)
queueprompt = QueuePrompt(Run=Button(), Python_exe=path_7, Python_script=json2py.pyfile, Arguments=comfyuisets.Arguments)  # -> out, Command; inputs Run: Boolean, Python_exe: String, Python_script: String, Arguments: String
# ---------- queueprompt: C# usings ----------
using System.Diagnostics;
using System.IO;
using System.Linq;
# ---------- queueprompt: C# ----------
    //------------------------------------------
    Component.Name = "Queue Prompt";
    Component.NickName = "QueuePrompt";
    Component.Category = "Params";
    Component.SubCategory = "ComfyUI";
    Component.Description = "Queue Prompt";
    Component.Params.Input[0].NickName = "Run";
    Component.Params.Input[1].NickName = "Python_exe";
    Component.Params.Input[2].NickName = "Python_script";
    Component.Params.Input[3].NickName = "Arguments";
    Component.Params.Input[0].Description = "Button to run the Queue";
    Component.Params.Input[1].Description = "Path of ComfyUI python.exe";
    Component.Params.Input[2].Description = "Path of the converted python script from Json file";
    Component.Params.Input[3].Description = "Command arguments";
    //------------------------------------------

    if(Python_exe == null || Python_script == null || Arguments == null) return;

    Process process = null;

    // Set up process start info
    ProcessStartInfo startInfo = new ProcessStartInfo();
    startInfo.FileName = Python_exe;
    startInfo.Arguments = Python_script + " " + Arguments;
    //startInfo.CreateNoWindow = false; // This prevents the command prompt window from appearing
    startInfo.UseShellExecute = false;
    startInfo.RedirectStandardOutput = true;

    Command = startInfo.Arguments;
    // Start the process
    if (Run)
    {
      process = Process.Start(startInfo);
    }
# ---------- end queueprompt ----------
# H:\rh_comfyui\Comfy_GH_example.py --GHString_model "Reliberate_v3.safetensors" --GHInteger_width 512 --GHInteger_height 512 --GHInteger_seed 1686199578 --GHInteger_steps 10 --GHString_sampler dpmpp_2m_sde --GHString_scheduler karras --GHFloat_cfg 5 --GHFloat_denoise 1 --GHPrompt_positive "cute monster" --GHPrompt_negative "text, watermark, ugly" --GHInteger_batch 1 --APIjsonfile "H:\rh_comfyui\Comfy_GH_example.json"
panel_5 = Panel(queueprompt.Command)
